# Grasshopper definition regular tetrahedron.gh (Grasshopper 1.0.7)

number_slider = Slider(7, range=0..100)
a_x_y = GhPythonScript(x=number_slider, y=Slider(2, range=0..100))  # -> out, a
# ---------- a_x_y: Python ----------
__author__ = "sator"
__version__ = "2023.04.26"

import rhinoscriptsyntax as rs

a = x * y
# ---------- end a_x_y ----------
a_x_y_2 = GhPythonScript(x=Slider(1, range=0..100), y=Slider(5, range=0..100))  # -> out, a
# ---------- a_x_y_2: Python ----------
__author__ = "sator"
__version__ = "2023.04.26"

import rhinoscriptsyntax as rs

a = x / y
# ---------- end a_x_y_2 ----------
radgrid = Radial(Plane=PlaneXY(0, 0, 0), Size=number_slider, ExtentR=Slider(1, range=0..100), ExtentP=Slider(5, range=0..100))  # -> Cells, Points; disabled
panel = Panel(radgrid.Points)
vec = VectorXYZ(XComponent=Slider(0, range=0..50), YComponent=Slider(0, range=0..50), ZComponent=Slider(0, range=0..50))  # -> Vector, Length
pi = Pi(Factor=a_x_y_2.a)
sqrt = SquareRoot(Value=Slider(2, range=0..50))
division = Division(A=sqrt, B=Slider(4, range=0..50))
item = ListItem(List=radgrid.Points, Index=Slider(0, range=0..100), Wrap=True)
panel_2 = Panel(item)
vec_2 = VectorXYZ(XComponent=Slider(0, range=0..50), YComponent=Slider(0, range=0..50), ZComponent=division)  # -> Vector, Length
rotate = Rotate(Geometry=radgrid.Points, Angle=pi, Plane=PlaneXY(0, 0, 0))  # -> Geometry, Transform
X = UnitX(Factor=1)
Y = UnitY(Factor=1)
Z = UnitZ(Factor=1)
_4face = GhPythonScript()  # -> out, a, b
# ---------- _4face: Python ----------
__author__ = "sator"
__version__ = "2023.04.28"

import rhinoscriptsyntax as rs
import math

faces = []
triangle_points = []

for i in range(0, 3):
    angle = 2.0 * math.pi / 3 * i
    triangle_points.append(rs.CreatePoint([math.cos(angle), math.sin(angle), 0]))

triangle_points.append(rs.CreatePoint([0, 0, math.sqrt(2)]));


faces.append(rs.AddSrfPt([triangle_points[2], triangle_points[1], triangle_points[0]]))
faces.append(rs.AddSrfPt([triangle_points[0], triangle_points[1], triangle_points[3]]))
faces.append(rs.AddSrfPt([triangle_points[1], triangle_points[2], triangle_points[3]]))
faces.append(rs.AddSrfPt([triangle_points[2], triangle_points[0], triangle_points[3]]))

a = faces
# ---------- end _4face ----------
ln = Line(StartPoint=X, EndPoint=vec.Vector)
panel_3 = Panel(rotate.Geometry)
vec_3 = VectorXYZ(XComponent=Slider(0, range=0..50), YComponent=Slider(0, range=0..50), ZComponent=Slider(0, range=0..50))  # -> Vector, Length
ln_2 = Line(StartPoint=Y, EndPoint=vec.Vector)
ln_3 = Line(StartPoint=Z, EndPoint=vec.Vector)
base_hexagon = SimpleMesh(Brep=radgrid.Cells)  # disabled
subtraction = Subtraction(A=vec_3.Vector, B=vec_2.Vector)
move = Move(Geometry=_4face.a, Motion=subtraction)  # -> Geometry, Transform
origin = VectorXYZ(XComponent=Slider(0, range=0..10), YComponent=Slider(0, range=0..10), ZComponent=Slider(0, range=0..10))  # -> Vector, Length
scale = Scale(Geometry=rotate.Geometry, Center=origin.Vector, Factor=Slider(2, range=0..10))  # -> Geometry, Transform
rad = Radians(Degrees=Slider(180, range=0..360))
rotax = RotateAxis(Geometry=move.Geometry, Angle=rad, Axis=ln)  # -> Geometry, Transform
vec2pt = Vector2Pt(PointA=scale.Geometry, PointB=origin.Vector, Unitize=False)  # -> Vector, Length
rad_2 = Radians(Degrees=Slider(125, range=0..360))
panel_4 = Panel(vec2pt.Vector)
python = GhPythonScript(x=base_hexagon, y=vec2pt.Vector)  # -> out, a
# ---------- python: Python ----------
__author__ = "sator"
__version__ = "2023.04.26"

import rhinoscriptsyntax as rs

a = []

a.append(x)

for p in y:
    print p
    
print "len(y) ={}".format(len(y))
for i in range(int((len(y) / 3))):
    print "i={}".format(i)
    print "({},{},{})".format(y[i])
        
    
    #rs.TransformObject(x, rs.XformTranslation(p))
    #a.append(x)
# ---------- end python ----------
rotax_2 = RotateAxis(Geometry=rotax.Geometry, Angle=rad_2, Axis=ln_2)  # -> Geometry, Transform
pcen = PolygonCenter(Polyline=rotax_2.Geometry)  # -> CenterV, CenterE, CenterA
del = DelaunayMesh(Points=reverse(pcen.CenterV), Plane=PlaneXY(0, 0, 0))
del_2 = DelaunayMesh(Points=pcen.CenterV, Plane=PlaneXY(0, 0, 0))
merge = Merge(Data1=del, Data2=del_2)
mjoin = MeshJoin(Meshes=merge)
faceb = FaceBoundaries(Mesh=mjoin)
boundary = BoundarySurfaces(Edges=faceb)
bvol = BoundaryVolume(Boundaries=rotax_2.Geometry)
bvol_2 = BoundaryVolume(Boundaries=boundary)
scale_2 = Scale(Geometry=bvol_2, Center=vec.Vector, Factor=Slider(3, range=0.001..10))  # -> Geometry, Transform
midpt = CurveMiddle()
sint = SolidIntersection(BrepsA=bvol, BrepsB=scale_2.Geometry)
edges = BrepEdges(Brep=sint)  # -> Naked, Interior, NonManifold
end = EndPoints(Curve=edges.Interior)  # -> Start, End
del_3 = DelaunayMesh(Plane=PlaneXY(0, 0, 0))
preview = CustomPreview(
    Geometry=sint,
    Material={diffuse=RGB(221, 160, 221), emission=RGB(66, 48, 66), shine=0.5, specular=RGB(255, 255, 255), transparency=0})
divlength = DivideLength(Curve=edges.Interior, Length=Slider(0.744, range=0.001..10))  # -> flatten(Points), Tangents, Parameters
debrep = DeconstructBrep(Brep=sint)  # -> Faces, Edges, Vertices
edges_2 = BrepEdges(Brep=sint)  # -> Naked, Interior, NonManifold
pcen_2 = PolygonCenter(Polyline=debrep.Faces)  # -> CenterV, CenterE, CenterA
polygon = Polygon(Plane=debrep.Faces, Radius=Slider(1.813, range=0.001..10), Segments=Slider(3, range=0.001..10), FilletRadius=0)  # -> Polygon, Length
item_2 = ListItem(List=debrep.Edges, Index=Slider(7, range=0..10), Wrap=True)
item_3 = ListItem(List=debrep.Edges, Index=Slider(6, range=0..10), Wrap=True)
item_4 = ListItem(List=debrep.Edges, Index=Slider(9, range=0..10), Wrap=True)
item_5 = ListItem(List=debrep.Edges, Index=Slider(4, range=0..10), Wrap=True)
item_6 = ListItem(List=debrep.Edges, Index=Slider(0, range=0..10), Wrap=True)
item_7 = ListItem(List=debrep.Edges, Index=Slider(5, range=0..10), Wrap=True)
item_8 = ListItem(List=debrep.Edges, Index=Slider(8, range=0..10), Wrap=True)
item_9 = ListItem(List=debrep.Edges, Index=Slider(3, range=0..10), Wrap=True)
item_10 = ListItem(List=debrep.Edges, Index=Slider(1, range=0..10), Wrap=True)
item_11 = ListItem(List=debrep.Edges, Index=Slider(2, range=0..10), Wrap=True)
item_12 = ListItem(List=debrep.Edges, Index=Slider(10, range=0..10), Wrap=True)
item_13 = ListItem(List=debrep.Edges, Index=Slider(11, range=0..15), Wrap=True)
number_slider_2 = Slider(0.627768, range=0.001..1)
subtraction_2 = Subtraction(A=Slider(1, range=0.001..10), B=number_slider_2)
item_14 = ListItem(List=polygon.Polygon, Index=Slider(0, range=0..10), Wrap=True)
item_15 = ListItem(List=polygon.Polygon, Index=Slider(1, range=0..10), Wrap=True)
item_16 = ListItem(List=polygon.Polygon, Index=Slider(6, range=0..10), Wrap=True)
item_17 = ListItem(List=polygon.Polygon, Index=Slider(5, range=0..10), Wrap=True)
item_18 = ListItem(List=polygon.Polygon, Index=Slider(2, range=0..10), Wrap=True)
item_19 = ListItem(List=polygon.Polygon, Index=Slider(3, range=0..10), Wrap=True)
item_20 = ListItem(List=polygon.Polygon, Index=Slider(4, range=0..10), Wrap=True)
item_21 = ListItem(List=polygon.Polygon, Index=Slider(7, range=0..10), Wrap=True)
eval = EvaluateLength(Curve=item_4, Length=subtraction_2, Normalized=True)  # -> Point, Tangent, Parameter
eval_2 = EvaluateLength(Curve=item_5, Length=number_slider_2, Normalized=True)  # -> Point, Tangent, Parameter
eval_3 = EvaluateLength(Curve=item_6, Length=number_slider_2, Normalized=True)  # -> Point, Tangent, Parameter
eval_4 = EvaluateLength(Curve=item_3, Length=number_slider_2, Normalized=True)  # -> Point, Tangent, Parameter
eval_5 = EvaluateLength(Curve=item_7, Length=subtraction_2, Normalized=True)  # -> Point, Tangent, Parameter
eval_6 = EvaluateLength(Curve=item_8, Length=subtraction_2, Normalized=True)  # -> Point, Tangent, Parameter
eval_7 = EvaluateLength(Curve=item_9, Length=subtraction_2, Normalized=True)  # -> Point, Tangent, Parameter
eval_8 = EvaluateLength(Curve=item_10, Length=subtraction_2, Normalized=True)  # -> Point, Tangent, Parameter
eval_9 = EvaluateLength(Curve=item_2, Length=subtraction_2, Normalized=True)  # -> Point, Tangent, Parameter
eval_10 = EvaluateLength(Curve=item_11, Length=subtraction_2, Normalized=True)  # -> Point, Tangent, Parameter
eval_11 = EvaluateLength(Curve=item_12, Length=number_slider_2, Normalized=True)  # -> Point, Tangent, Parameter
eval_12 = EvaluateLength(Curve=item_13, Length=subtraction_2, Normalized=True)  # -> Point, Tangent, Parameter
merge_2 = Merge(
    Data1=eval_3.Point,
    Data2=eval_8.Point,
    Data3=eval_10.Point,
    Data4=eval_7.Point,
    Data5=eval_2.Point,
    Data6=eval_5.Point,
    Data7=eval_4.Point,
    Data8=eval_9.Point,
    Data9=eval_6.Point,
    Data10=eval.Point,
    Data11=eval_11.Point,
    Data12=eval_12.Point)
srf_cp = SurfaceClosestPoint(Point=merge_2, Surface=item_14)  # -> Point, UVPoint, Distance
srf_cp_2 = SurfaceClosestPoint(Point=merge_2, Surface=item_15)  # -> Point, UVPoint, Distance
srf_cp_3 = SurfaceClosestPoint(Point=merge_2, Surface=item_16)  # -> Point, UVPoint, Distance
srf_cp_4 = SurfaceClosestPoint(Point=merge_2, Surface=item_17)  # -> Point, UVPoint, Distance
srf_cp_5 = SurfaceClosestPoint(Point=merge_2, Surface=item_18)  # -> Point, UVPoint, Distance
srf_cp_6 = SurfaceClosestPoint(Point=merge_2, Surface=item_19)  # -> Point, UVPoint, Distance
srf_cp_7 = SurfaceClosestPoint(Point=merge_2, Surface=item_20)  # -> Point, UVPoint, Distance
srf_cp_8 = SurfaceClosestPoint(Point=merge_2, Surface=item_21)  # -> Point, UVPoint, Distance
dispatch = Dispatch(List=srf_cp.Point, DispatchPattern=srf_cp.Distance)  # -> ListA, ListB
dispatch_2 = Dispatch(List=srf_cp_2.Point, DispatchPattern=srf_cp_2.Distance)  # -> ListA, ListB
dispatch_3 = Dispatch(List=srf_cp_3.Point, DispatchPattern=srf_cp_3.Distance)  # -> ListA, ListB
dispatch_4 = Dispatch(List=srf_cp_4.Point, DispatchPattern=srf_cp_4.Distance)  # -> ListA, ListB
dispatch_5 = Dispatch(List=srf_cp_5.Point, DispatchPattern=srf_cp_5.Distance)  # -> ListA, ListB
dispatch_6 = Dispatch(List=srf_cp_6.Point, DispatchPattern=srf_cp_6.Distance)  # -> ListA, ListB
dispatch_7 = Dispatch(List=srf_cp_7.Point, DispatchPattern=srf_cp_7.Distance)  # -> ListA, ListB
dispatch_8 = Dispatch(List=srf_cp_8.Point, DispatchPattern=srf_cp_8.Distance)  # -> ListA, ListB
cps = ClosestPoints(Point=eval_3.Point, Cloud=merge_2, Count=Slider(6, range=0..10))  # -> ClosestPoint, CPIndex, Distance
del_4 = DelaunayMesh(Points=dispatch.ListB, Plane=item_14)
del_5 = DelaunayMesh(Points=dispatch_2.ListB, Plane=item_15)
del_6 = DelaunayMesh(Points=dispatch_3.ListB, Plane=item_16)
del_7 = DelaunayMesh(Points=dispatch_4.ListB, Plane=item_17)
del_8 = DelaunayMesh(Points=dispatch_5.ListB, Plane=item_18)
del_9 = DelaunayMesh(Points=dispatch_6.ListB, Plane=item_19)
del_10 = DelaunayMesh(Points=dispatch_7.ListB, Plane=item_20)
del_11 = DelaunayMesh(Points=dispatch_8.ListB, Plane=item_21)
merge_3 = Merge(Data1=del_4, Data2=del_5, Data3=del_8, Data4=del_9, Data5=del_10, Data6=del_7, Data7=del_6, Data8=del_11)
faceb_2 = FaceBoundaries(Mesh=merge_3)
