# Grasshopper definition shrink_obj.gh (Grasshopper 1.0.7)

geo = Geometry(<mesh referenced from the Rhino model>)
hide_rhino_geo = GhPythonScript(Geo=geo, show=Toggle(False))  # inputs Geo: Guid, show: Boolean
# ---------- hide_rhino_geo: Python ----------
__author__ = "sator"
__version__ = "2023.05.24"

import rhinoscriptsyntax as rs
import Rhino as rh
import scriptcontext as sc
sc.doc = rh.RhinoDoc.ActiveDoc
if show:
    rs.HideObjects(Geo)
else:
    rs.ShowObjects(Geo)
# ---------- end hide_rhino_geo ----------
vec = VectorXYZ(XComponent=0, YComponent=Slider(0, range=0..126), ZComponent=0)  # -> Vector, Length
move = Move(Geometry=geo, Motion=vec.Vector)  # -> Geometry, Transform
faceb = FaceBoundaries(Mesh=move.Geometry)
facec = FaceCircles(Mesh=move.Geometry)  # -> Centers, Ratio
pt = Point(facec.Centers)
crv = Curve(faceb)
incurve = PointInCurve(Point=pt, Curve=faceb)  # -> Relationship, Point
pt_2 = Point(incurve.Point)
incurve_2 = PointInCurve(Point=pt, Curve=crv)  # -> Relationship, Point
equals = Equality(FirstNumber=incurve.Relationship, SecondNumber=Slider(0, range=0..2))  # -> Equality, Inequality
equals_2 = Equality(FirstNumber=incurve_2.Relationship, SecondNumber=Slider(0, range=0..2))  # -> Equality, Inequality
dispatch = Dispatch(List=pt_2, DispatchPattern=equals.Inequality)  # -> ListA, ListB
dispatch_2 = Dispatch(List=crv, DispatchPattern=equals_2.Inequality)  # -> ListA, ListB
crv_2 = Curve(dispatch_2.ListB)
explode = Explode(Curve=crv_2, Recursive=True)  # -> Segments, Vertices
pt_3 = Point(dispatch.ListA)
line = Line(explode.Segments)
crv_3 = Curve(dispatch_2.ListA)
len = Length(Curve=line)
sort = SortList(Keys=len, ValuesA=line)  # -> Keys, ValuesA
item = ListItem(List=sort.ValuesA, Index=Slider(2, range=0..2), Wrap=True)
number_slider = Slider(0.357, range=0.001..1)
longest_edge = Line(item)
scale = Scale(Geometry=crv_3, Center=Point(0, 0, 0), Factor=number_slider)  # -> Geometry, Transform
scale_2 = Scale(Geometry=pt_3, Center=Point(0, 0, 0), Factor=number_slider)  # -> Geometry, Transform
explode_2 = Explode(Curve=crv_3, Recursive=True)  # -> Segments, Vertices
circumcenter = Point(graft(pt_3))
line_2 = Line(explode_2.Segments)
crv_cp = CurveClosestPoint(Point=circumcenter, Curve=line_2)  # -> Point, Parameter, Distance
eval = EvaluateCurve(Curve=line_2, Parameter=crv_cp.Parameter)  # -> Point, Tangent, Angle
drop_point_from_circumcenter_to_each_edg = Point(eval.Point)  # "drop point from circumcenter to each edge"
end = EndPoints(Curve=line_2)  # -> Start, End
srf4pt = _4PointSurface(CornerA=circumcenter, CornerB=end.End, CornerC=drop_point_from_circumcenter_to_each_edg)
srf4pt_2 = _4PointSurface(CornerA=circumcenter, CornerB=end.Start, CornerC=drop_point_from_circumcenter_to_each_edg)
