# Grasshopper definition surface_area.gh (Grasshopper 1.0.7)

animation_sequence = Slider(0, range=0..1)
panel = Panel("100")
_2º = PowerOf2(Value=Slider(9, range=-1..20))
sph = Sphere(Base=PlaneXY(0, 0, 0), Radius=1)
vec = VectorXYZ(XComponent="25", YComponent="25", ZComponent="25")  # -> Vector, Length
number_slider = Slider(2.829755, range=0.1..15)
move = Move(Geometry=sph, Motion=vec.Vector)  # -> Geometry, Transform
python = GhPythonScript(x=animation_sequence)  # -> out; disabled
# ---------- python: Python ----------
__author__ = "sator"
__version__ = "2023.07.07"

import rhinoscriptsyntax as rs
if x == 0:
    path = "result.txt"
    f = open(path, "w")
    f.write(str(0))
    f.close()
    
a = "do update!"
# ---------- end python ----------
z_range_min = Number("0")
z_range_max = Number("50")
domain_max = Number("50")
domain_min = Number("0")
dom = ConstructDomain(DomainStart=domain_min, DomainEnd=domain_max)
split_num = Number(_2º)
multiplication = Multiplication(A=animation_sequence, B=split_num)
multiplication_2 = Multiplication(A=multiplication, B=split_num)
multiplication_3 = Multiplication(A=animation_sequence, B=split_num)
mod = Modulus(A=multiplication_2, B=split_num)
round = Round(Number=multiplication_3)  # -> Nearest, Floor, Ceiling
round_2 = Round(Number=mod)  # -> Nearest, Floor, Ceiling
y = Number(round_2.Floor)
x = Number(round.Floor)
range = Range(Domain=dom, Steps=split_num)
range_2 = Range(Domain=dom, Steps=split_num)
scale = Scale(Geometry=move.Geometry, Center=vec.Vector, Factor="20")  # -> Geometry, Transform
multiplication_4 = Multiplication()
vec_2 = VectorXYZ(XComponent="5", YComponent="5", ZComponent="5")  # -> Vector, Length
multiplication_5 = Multiplication(A=Slider(0.435, range=0..1), B=domain_max)
multiplication_6 = Multiplication(A=Slider(0.697, range=0..1), B=domain_max)
rectangle = Rectangle(Plane=PlaneXY(0, 0, 0), XSize="40", YSize="40", Radius=0)  # -> Rectangle, Length
division = Division(A="1", B=number_slider)
item = ListItem(List=range_2, Index=y, Wrap=True)
panel_2 = Panel(x)
item_2 = ListItem(List=range, Index=x, Wrap=True)
dx = Number(Slider(0.647723, range=0.1..39.9))
dy = Number(Slider(0.56828, range=0.1..40))
move_2 = Move(Geometry=rectangle.Rectangle, Motion=vec_2.Vector)  # -> Geometry, Transform
x_2 = Number(multiplication_5)
y_2 = Number(multiplication_6)
number_slider_2 = Slider(24, range=0..24)
num = Number(graft(item_2))
srf = Surface(move_2.Geometry)
subtraction = Subtraction(A="44.9", B=dx)
subtraction_2 = Subtraction(A="44.9", B=dy)
panel_3 = Panel(y)
rectangle_2 = Rectangle(Plane=PlaneXY(0, 0, 0), XSize=dx, YSize=dy, Radius=0)  # -> Rectangle, Length
vec_3 = VectorXYZ(XComponent=num, YComponent=item, ZComponent=0)  # -> flatten(Vector), Length
vec_4 = VectorXYZ(XComponent=x_2, YComponent=y_2, ZComponent=0)  # -> Vector, Length
subtraction_3 = Subtraction(A=domain_min, B=domain_max)
pcen = PolygonCenter(Polyline=srf)  # -> CenterV, CenterE, CenterA
sdivide = DivideSurface(Surface=srf, UCount=number_slider_2, VCount=number_slider_2)  # -> flatten(Points), Normals, Parameters
min = Minimum(A=x_2, B=subtraction_2)
min_2 = Minimum(A=x_2, B=subtraction)
abs = Absolute(Value=subtraction_3)
vec_5 = VectorXYZ(XComponent=min_2, YComponent=min, ZComponent=0)  # -> Vector, Length
ln = Line(StartPoint=pcen.CenterV, EndPoint=sdivide.Points)
division_2 = Division(A=abs, B=split_num)
focuspoint = Vector(vec_4.Vector)
domain_width = Number(division_2)
move_3 = Move(Geometry=rectangle_2.Rectangle, Motion=vec_5.Vector)  # -> Geometry, Transform
len = Length(Curve=ln)  # -> simplify(Length)
vec_6 = Vector(graft(vec_3.Vector))
panel_4 = Panel(len)
boundary = BoundarySurfaces(Edges=move_3.Geometry)
panel_5 = Panel(vec_6)
bnd = Bounds(Numbers=len)
multiplication_7 = Multiplication(A=Slider(3, range=0..24), B="360")
remap = RemapNumbers(Value=len, Source=bnd, Target=multiplication_7)  # -> Mapped, Clipped
xy = XYPlane(Origin=Point(0, 0, 0))
scale_2 = Number(number_slider)
rectangle_3 = Rectangle(Plane=xy, XSize=domain_width, YSize=domain_width, Radius=0)  # -> Rectangle, Length
panel_6 = Panel(remap.Mapped)
rad = Radians(Degrees=remap.Mapped)
boundary_2 = BoundarySurfaces(Edges=rectangle_3.Rectangle)
sin = Sine(Value=rad)
move_4 = Move(Geometry=boundary_2, Motion=vec_6)  # -> Geometry, Transform
z_range_min_2 = Number(z_range_min)
z_range_max_2 = Number(z_range_max)
multiplication_8 = Multiplication(A=sin, B=Slider(2, range=0..500))
Z = UnitZ(Factor=multiplication_8)
subtraction_4 = Subtraction(A=z_range_min_2, B=z_range_max_2)
move_5 = Move(Geometry=sdivide.Points, Motion=Z)  # -> flatten(Geometry), Transform
addition = Addition(A=number_slider_2, B="1")
abs_2 = Absolute(Value=subtraction_4)
z_range_width = Number(abs_2)
srfgrid = SurfaceFromPoints(Points=move_5.Geometry, UCount=addition, Interpolate=False)
vec_7 = Vector(focuspoint)
Z_2 = UnitZ(Factor=abs_2)
extr = Extrude(Base=boundary, Direction=Z_2)
bvol = BoundaryVolume(Boundaries=extr)
extr_2 = Extrude(Base=move_4.Geometry, Direction=Z_2)
srf_2 = Surface(srfgrid)
bvol_2 = BoundaryVolume(Boundaries=extr_2)
swatch = ColourSwatch(SwatchColor=RGB(179, 72, 194))  # disabled
sint = SolidIntersection(BrepsA=srf_2, BrepsB=bvol)
preview = CustomPreview(Geometry=bvol_2, Material=swatch)  # disabled
null = NullItem(Item=sint)  # -> NullFlags, InvalidFlags, Description
and = GateAnd(A=null.NullFlags, B=null.InvalidFlags)
dispatch = Dispatch(List=sint, DispatchPattern=and)  # -> ListA, ListB
brep = Brep(flatten(dispatch.ListB))
multiplication_9 = Multiplication(A="0.01", B=scale_2)
scale_3 = Scale(Geometry=srf_2, Center=vec_7, Factor=scale_2)  # -> Geometry, Transform
scale_4 = Scale(Geometry=brep, Center=vec_7, Factor=scale_2)  # -> Geometry, Transform
debrep = DeconstructBrep(Brep=brep)  # -> Faces, Edges, Vertices
lng = ListLength(List=debrep.Faces)
swatch_2 = ColourSwatch(SwatchColor=RGB(132, 204, 90))  # disabled
equals = Equality(FirstNumber=lng, SecondNumber="6")  # -> Equality, Inequality
panel_7 = Panel(lng)
preview_2 = CustomPreview(Geometry=scale_3.Geometry, Material=ColourSwatch(SwatchColor=RGB(30, 230, 193)))
preview_3 = CustomPreview(Geometry=scale_4.Geometry, Material=ColourSwatch(SwatchColor=RGB(251, 164, 87)))
dispatch_2 = Dispatch(List=debrep.Faces, DispatchPattern=equals.Equality)  # -> ListA, ListB
srf_3 = Surface(flatten(dispatch_2.ListA))
mesh = Mesh(srf_3)
demesh = DeconstructMesh(Mesh=mesh)  # -> Vertices, Faces, Colours, Normals
facen = FaceNormals(Mesh=srf_3)  # -> Centers, Normals
panel_8 = Panel("{0}")
Z_3 = UnitZ(Factor=1)
dprod = DotProduct(VectorA=demesh.Normals, VectorB=Z_3, Unitize=False)
avr = Average(Input=dprod)  # -> flatten(ArithmeticMean)
abs_3 = Absolute(Value=avr)
smaller = SmallerThan(FirstNumber=abs_3, SecondNumber="0.001")  # -> SmallerThan, OrEqualTo
dispatch_3 = Dispatch(List=srf_3, DispatchPattern=smaller.SmallerThan)  # -> ListA, ListB
dispatch_4 = Dispatch(List=dispatch_3.ListB, DispatchPattern=smaller.SmallerThan)  # -> ListA, ListB
srf_4 = Surface(dispatch_4.ListA)
mesh_2 = Mesh(srf_4)
demesh_2 = DeconstructMesh(Mesh=mesh_2)  # -> Vertices, Faces, Colours, Normals
pdecon = Deconstruct(Point=demesh_2.Vertices)  # -> XComponent, YComponent, ZComponent
vec_8 = VectorXYZ(XComponent=pdecon.XComponent, YComponent=pdecon.YComponent, ZComponent=0)  # -> Vector, Length
z_range_width_2 = Number(z_range_width)
sort = SortList(Keys=vec_8.Length, ValuesA=demesh_2.Vertices)  # -> Keys, ValuesA
vec_9 = VectorXYZ(XComponent=z_range_width_2, YComponent=0, ZComponent=0)  # -> Vector, Length
Z_4 = UnitZ(Factor=1)
X = UnitX(Factor=1)
vec_10 = VectorXYZ(XComponent=0, YComponent=z_range_width_2, ZComponent=0)  # -> Vector, Length
vec_11 = VectorXYZ(XComponent=0, YComponent=0, ZComponent=0)  # -> Vector, Length
devec = DeconstructVector(Vector=demesh_2.Vertices)  # -> XComponent, YComponent, ZComponent
pl_3pt = Plane3Pt(PointA=Z_4, PointB=X, PointC=vec_11.Vector)
lng_2 = ListLength(List=sort.ValuesA)
vec_12 = VectorXYZ(XComponent=devec.XComponent, YComponent=devec.YComponent, ZComponent=0)  # -> Vector, Length
subtraction_5 = Subtraction(A=lng_2, B="1")
planesrf = PlaneSurface(Plane=pl_3pt, XSize="1", YSize="1")
X_2 = UnitX(Factor=1)
item_3 = ListItem(List=sort.ValuesA, Index=subtraction_5, Wrap=True)
item_4 = ListItem(List=sort.ValuesA, Index=0, Wrap=True)
addition_2 = Addition(A=item_4, B=vec_10.Vector)
addition_3 = Addition(A=item_4, B=vec_9.Vector)
vec_13 = VectorXYZ(XComponent=0, YComponent=0, ZComponent=0)  # -> Vector, Length
multiplication_10 = Multiplication(A=X_2, B="100")
subtraction_6 = Subtraction(A=vec_12.Vector, B=addition_3)
ln_2 = Line(StartPoint=multiplication_10, EndPoint=vec_13.Vector)
subtraction_7 = Subtraction(A=vec_12.Vector, B=addition_2)
vlen = VectorLength(Vector=subtraction_6)
vlen_2 = VectorLength(Vector=subtraction_7)
sort_2 = SortList(Keys=vlen, ValuesA=demesh_2.Vertices)  # -> Keys, ValuesA
sort_3 = SortList(Keys=vlen_2, ValuesA=demesh_2.Vertices)  # -> Keys, ValuesA
item_5 = ListItem(List=sort_3.ValuesA, Index=0, Wrap=True)
item_6 = ListItem(List=sort_2.ValuesA, Index=0, Wrap=True)
addition_4 = Addition(A=item_6, B=item_5)
subtraction_8 = Subtraction(A=addition_4, B=item_4)
subtraction_9 = Subtraction(A=item_6, B=item_4)
subtraction_10 = Subtraction(A=item_5, B=item_4)
points = PointList(Points=subtraction_8)
ln_3 = Line(StartPoint=item_6, EndPoint=item_4)
scale_5 = Scale(Geometry=ln_3, Center=vec_7, Factor=scale_2)  # -> Geometry, Transform
pipe = Pipe(Curve=scale_5.Geometry, Radius="0.01", Caps=0)
preview_4 = CustomPreview(Geometry=pipe, Material=swatch_2)  # disabled
ln_4 = Line(StartPoint=item_5, EndPoint=item_4)
scale_6 = Scale(Geometry=ln_4, Center=vec_7, Factor=scale_2)  # -> Geometry, Transform
pipe_2 = Pipe(Curve=scale_6.Geometry, Radius="0.01", Caps=0)
preview_5 = CustomPreview(Geometry=pipe_2, Material=swatch_2)  # disabled
merge = Merge(Data1=item_4, Data2=item_6, Data3=subtraction_8, Data4=item_5)
xprod = CrossProduct(VectorA=subtraction_9, VectorB=subtraction_10, Unitize=False)  # -> Vector, Length
conmesh = ConstructMesh(Vertices=merge, Faces={A=0, B=1, C=2, D=3})
scale_7 = Scale(Geometry=conmesh, Center=vec_7, Factor=scale_2)  # -> Geometry, Transform
preview_6 = CustomPreview(Geometry=scale_7.Geometry, Material=ColourSwatch(SwatchColor=RGB(136, 250, 87)))
num_2 = Number(flatten(xprod.Length))
ma = MassAddition(Input=num_2)  # -> Result, PartialResults
python_2 = GhPythonScript(x=ma.Result, update_point=python)  # -> out, a
# ---------- python_2: Python ----------
__author__ = "sator"
__version__ = "2023.07.07"

import rhinoscriptsyntax as rs

path = "result.txt"
f = open(path, 'r')
a = f.read()
f.close()

a = "this vertex area = " + str(x) + "\n sum = " + a
# ---------- end python_2 ----------
textsrf = TextOnSurface(Text=python_2.a, Font="Sans Bold:no Italic:no", Height="10", Depth=0.4, BaseLine=ln_2, BaseSurface=planesrf)
python_3 = GhPythonScript(result=ma.Result)  # -> out, a
# ---------- python_3: Python ----------
__author__ = "sator"
__version__ = "2023.07.07"

import rhinoscriptsyntax as rs


path = 'result.txt'
print result
if result is not None:
    f = open(path, 'r')
    prev = float(f.read())
    f.close()
    
    f = open(path, 'w')
    f.write(str(prev + result))
    f.close()
# ---------- end python_3 ----------
panel_9 = Panel(ma.Result)
division_3 = Division(A=ma.Result, B="2")
panel_10 = Panel(division_3)
